# Grasshopper definition personable_robotics_osc.gh (Grasshopper 1.0.7)
# plug-ins: Firefly.X, Fologram For Grasshopper Utilities

# This example streams out a `tcp_target` and
# `tcp_look_at` point over OSC every time you
# move the points in the corresponding
# personable_robotics_osc.3dm file.
panel = Panel("10000")
int = Integer("10002")
int_2 = Integer(panel)
int_3 = Integer("10003")
int_4 = Integer("10004")
int_5 = Integer("10005")

# ---- group: Test Receiving Locally
timer = Timer(Interval=20, TimerInterval=20, Target=osc_listener)
osc_listener = OSCListener(Port=int_2, Reset=Toggle(True))
panel_2 = Panel(osc_listener)

timer_2 = Timer(Interval=20, TimerInterval=20, Target=osc_listener_2)
osc_listener_2 = OSCListener(Port=int, Reset=Toggle(True))
panel_3 = Panel(osc_listener_2)

timer_3 = Timer(Interval=20, TimerInterval=20, Target=osc_listener_3)
osc_listener_3 = OSCListener(Port=int_4, Reset=Toggle(True))
panel_4 = Panel(osc_listener_3)

timer_4 = Timer(Interval=20, TimerInterval=20, Target=osc_listener_4)
osc_listener_4 = OSCListener(Port=int_5, Reset=Toggle(True))
panel_5 = Panel(osc_listener_4)

timer_5 = Timer(Interval=2000, TimerInterval=2000, Target=osc_listener_5)
osc_listener_5 = OSCListener(Port=int_3, Reset=Toggle(True))
panel_6 = Panel(osc_listener_5)

# ----
z_control = Slider(551, range=0..10000)
x_control = Slider(28, range=0..1000)
lookat_control = Slider(-47, range=-4000..2000)
item = ListItem(List=panel_4, Index=0, Wrap=True)  # -> Item1, Item
item_2 = ListItem(List=panel_5, Index=0, Wrap=True)  # -> Item1, Item
item_3 = ListItem(List=panel_6, Index=0, Wrap=True)  # -> Item1, Item
item_4 = ListItem(List=panel_3, Index=0, Wrap=True)  # -> Item1, Item
item_5 = ListItem(List=panel_2, Index=0, Wrap=True)  # -> Item1, Item
seconds = Data(item_2.Item1)
frames = Data(item.Item1)
# Touch OSC
int_6 = Integer("8000")
rec = DataRecorder(item_3.Item1, DataLimit=-10, RecordData=True)

# ---- group: TOUCH OSC
timer_6 = Timer(Interval=20, TimerInterval=20, Target=osc_listener_6)
osc_listener_6 = OSCListener(Port=int_6, Reset=Toggle(False))
panel_7 = Panel(osc_listener_6)

# ----
panel_8 = Panel(frames)
smaller = SmallerThan(FirstNumber=seconds, SecondNumber="1.25")  # -> SmallerThan, OrEqualTo
multiplication = Multiplication(A=item_5.Item1, B=z_control)
multiplication_2 = Multiplication(A=item_4.Item1, B=x_control)
ma = MassAddition(Input=rec)  # -> Result, PartialResults
crv = Curve(<curve referenced from the Rhino model>)
Z = UnitZ(Factor=multiplication)
panel_9 = Panel(ma.Result)
X = UnitX(Factor=multiplication_2)
z_control_2 = Slider(400, range=0..400)
panel_10 = Panel(rec)
divide = DivideCurve(Curve=crv, Count=Slider(30, range=0..100), Kinks=False)  # -> Points, Tangents, Parameters
neg = Negative(Value=frames)
filter = StreamFilter(Gate=smaller.SmallerThan, Stream0=frames, Stream1=neg)
item_6 = ListItem(List=divide.Points, Index=ma.Result, Wrap=True)
multiplication_3 = Multiplication(A=item_5.Item1, B=z_control_2)
neg_2 = Negative(Value=multiplication_3)
move = Move(Geometry=item_6, Motion=Z)  # -> Geometry, Transform
concat = Concatenate(FragmentA=multiplication_3, FragmentB=" to ", FragmentC=neg_2)
remap = RemapNumbers(Value=filter, Source="0 to 75", Target=concat)  # -> Mapped, Clipped
panel_11 = Panel(concat)
move_2 = Move(Geometry=move.Geometry, Motion=X)  # -> Geometry, Transform

# ---- group: Y ADJUST
# Y Adjust
bang = ExplodeTree(Data=osc_listener_6)  # -> Branch0, Branch1, Branch2, Branch3, Branch4, Branch5, Branch6
panel_12 = Panel(bang.Branch2)
item_7 = ListItem(List=bang.Branch2, Index=0, Wrap=True)  # -> Item, Item1
remap_2 = RemapNumbers(Value=item_7.Item1, Source=Domain(0, 1), Target="-400 to 400")  # -> Mapped, Clipped
panel_13 = Panel(remap_2.Mapped)

# ---- group: Touch Osc selection
# Mode Selection
item_8 = ListItem(List=osc_listener_6, Index=0, Wrap=True)  # -> Item, Item1
fragment = TextFragment(Text=item_8.Item, Start="1", Count="1")
trim = TextTrim(Text=fragment, Start=True, End=True)
num = Number(item_8.Item1)
num_2 = Number(trim)
value = Panel(num)
address = Panel(num_2)
python = GhPythonScript(index=num_2, value=num, reset=Button())  # -> buttons; inputs index: Int32, reset: Boolean
# ---------- python: Python ----------
__author__ = "alfred"
__version__ = "2022.06.02"

import rhinoscriptsyntax as rs
import scriptcontext as sc

if (sc.sticky.has_key("buttons") == False or reset):
    sc.sticky["buttons"] = [0,0]

changed = (sc.sticky["buttons"][index] != value)
if (changed):
    sc.sticky["buttons"][index] = value
buttons = sc.sticky["buttons"]
# ---------- end python ----------
item_9 = ListItem(List=python, Index=0, Wrap=True)  # -> Item, Item1
equals = Equality(FirstNumber=item_9.Item, SecondNumber="0")  # -> Equality, Inequality
equals_2 = Equality(FirstNumber=item_9.Item1, SecondNumber="0")  # -> Equality, Inequality
panel_14 = Panel(equals_2.Inequality)
panel_15 = Panel(equals.Inequality)
T = StateGate(States=equals.Inequality, LinkTarget=osc_sender_2)  # -> True, False
T_2 = StateGate(States=equals_2.Inequality, LinkTarget=osc_sender)  # -> True, False

# ----
tcp_target = Data(move_2.Geometry)
Y = UnitY(Factor=remap_2.Mapped)
move_3 = Move(Geometry=tcp_target, Motion=Y)  # -> Geometry, Transform
alfred_bob_change = Data(item_4.Item1)
tcp_target_2 = Data(move_3.Geometry)
remap_3 = RemapNumbers(Value=alfred_bob_change, Source="0 to 0.7", Target="-500 to 500")  # -> Mapped, Clipped
X_2 = UnitX(Factor=Slider(582, range=0..1000))
move_4 = Move(Geometry=tcp_target_2, Motion=X_2)  # -> Geometry, Transform
Z_2 = UnitZ(Factor=remap_3.Mapped)

# ---- group: Tcp Target
sph = Sphere(Base=tcp_target_2, Radius=Slider(40, range=0..100))

# ----
addition = Addition(A=move_4.Geometry, B=Z_2)
Z_3 = UnitZ(Factor=lookat_control)
addition_2 = Addition(A=addition, B=Z_3)
data = Data(remap.Mapped)
Z_4 = UnitZ(Factor=data)
move_5 = Move(Geometry=addition_2, Motion=Z_4)  # -> Geometry, Transform
look_at_target = Data(move_5.Geometry)

# ---- group: Look at Target
sph_2 = Sphere(Base=look_at_target, Radius=Slider(26, range=0..100))
preview = CustomPreview(Geometry=sph_2, Material=ColourSwatch(SwatchColor=RGBA(0, 0, 0, 149)))

# ----
panel_16 = Panel("192.168.11.158")
osc_sender = OSCSender(Data=look_at_target, IPAddressOfUDPServer="192.168.11.66", UDPPort="55553")  # disabled
osc_sender_2 = OSCSender(Data=tcp_target_2, IPAddressOfUDPServer="192.168.11.66", UDPPort="55553")  # disabled
